# Grasshopper definition Facade_kinetic.gh (Grasshopper 1.0.7)
# plug-ins: ShapeDiver

length_of_outerpoint = Slider(0.5, range=0..1)
rotate_number = Slider(16, range=0..45)
radius_of_modular = Slider(0.06, range=0..0.1)
size_of_modular = Slider(3, range=0..20)
number_of_x = Slider(5, range=0..100)
number_of_y = Slider(5, range=0..100)
pipe_radius = Slider(0.045, range=0..0.1)

# ----
# Step1_for_modular
xz_plane = XZPlane(Origin=Point(0, 0, 0))
unit_y = UnitY(Factor=1)
triangular = Triangular(Plane=xz_plane, Size=size_of_modular, ExtentX=number_of_x, ExtentY=number_of_y)  # -> Cells, Points
negative = Negative(Value=unit_y)
explode = Explode(Curve=triangular.Cells, Recursive=True)  # -> Segments, Vertices
area = Area(Geometry=triangular.Cells)  # -> Area, Centroid
point = Point(explode.Vertices)
line_sdl = LineSDL(Start=area.Centroid, Direction=negative, Length=length_of_outerpoint)
list_item = ListItem(List=point, Index=0, Wrap=True)  # -> Item, Item1, Item2
end_points = EndPoints(Curve=line_sdl)  # -> Start, graft(End)
list_item_2 = ListItem(List=explode.Segments, Index=0, Wrap=True)  # -> Item, Item1, Item2
line = Line(StartPoint=list_item.Item1, EndPoint=end_points.End)
line_2 = Line(StartPoint=list_item.Item, EndPoint=end_points.End)
line_3 = Line(StartPoint=list_item.Item2, EndPoint=end_points.End)

point_2 = Point(area.Centroid)
line_4 = Line(StartPoint=point, EndPoint=graft(point_2))

# ----
# Step2_for_modular_surface
shape_piece_2 = Curve([list_item_2.Item1, line, line_3])
shape_piece_1 = Curve([list_item_2.Item, line_2, line])
shape_piece_3 = Curve([line_2, line_3, list_item_2.Item2])
join_curves = JoinCurves(Curves=shape_piece_2, Preserve=False)
join_curves_2 = JoinCurves(Curves=shape_piece_1, Preserve=False)
join_curves_3 = JoinCurves(Curves=shape_piece_3, Preserve=False)
number = Number(radius_of_modular)
fillet = Fillet(Curve=join_curves_2, Radius=number)
fillet_2 = Fillet(Curve=join_curves, Radius=number)
fillet_3 = Fillet(Curve=join_curves_3, Radius=number)
boundary_surfaces = BoundarySurfaces(Edges=fillet)
boundary_surfaces_2 = BoundarySurfaces(Edges=fillet_2)
boundary_surfaces_3 = BoundarySurfaces(Edges=fillet_3)

# ----
# Step3_for_modular_rotate
axis_2 = Line(list_item_2.Item1)
axis_1 = Line(list_item_2.Item2)
axis_3 = Line(list_item_2.Item)
integer = Integer(rotate_number)
rotate = Rotate(Geometry=boundary_surfaces_2, Angle=degrees(integer), Plane=axis_2)  # -> Geometry, Transform
rotate_2 = Rotate(Geometry=boundary_surfaces, Angle=degrees(integer), Plane=axis_3)  # -> Geometry, Transform
rotate_3 = Rotate(Geometry=boundary_surfaces_3, Angle=degrees(integer), Plane=axis_1)  # -> Geometry, Transform

panel = Panel("https://i.pinimg.com/originals/26/31/7d/26317d6b48d085a717f8d3c4cadbea68.jpg")
curve = Curve([axis_3, axis_2, axis_1, line_4])
panel_2 = Panel("https://encrypted-tbn0.gstatic.com/images?q=tbn:ANd9GcTqrisP7dCEdZtq1ORuWaqsFVPBrByUdsbNVA&usqp=CAU")
geometry = Geometry([rotate_2.Geometry, rotate.Geometry, rotate_3.Geometry])
shapedivermaterial = ShapeDiverMaterial(Color=RGB(255, 255, 255), Texture=panel, FlatShading=False)
pipe = Pipe(Curve=curve, Radius=pipe_radius, Caps="2")
shapedivermaterial_2 = ShapeDiverMaterial(Color=RGB(255, 255, 255), Texture=panel_2, FlatShading=False)
shapediverdisplaygeometry = ShapeDiverDisplayGeometry(Geometry=geometry, ShapeDiverMaterial=shapedivermaterial)
shapediverdisplaygeometry_2 = ShapeDiverDisplayGeometry(Geometry=pipe, ShapeDiverMaterial=shapedivermaterial_2)
