# Grasshopper definition Facade_kinetic2_withsunpath.gh (Grasshopper 1.0.7)
# plug-ins: Heliotrope

length_of_outerpoint = Slider(0.53, range=0..1)
radius_of_modular = Slider(0.06, range=0..0.1)
size_of_modular = Slider(3, range=0..20)
number_of_x = Slider(6, range=0..100)
number_of_y = Slider(8, range=0..100)
pipe_radius = Slider(0.045, range=0..0.1)

# ----
# Step1_for_modular
xz_plane = XZPlane(Origin=Point(0, 0, 0))
unit_y = UnitY(Factor=1)
triangular = Triangular(Plane=xz_plane, Size=size_of_modular, ExtentX=number_of_x, ExtentY=number_of_y)  # -> Cells, Points
negative = Negative(Value=unit_y)
explode = Explode(Curve=triangular.Cells, Recursive=True)  # -> Segments, Vertices
area = Area(Geometry=triangular.Cells)  # -> Area, Centroid
line_sdl = LineSDL(Start=area.Centroid, Direction=negative, Length=length_of_outerpoint)
end_points = EndPoints(Curve=line_sdl)  # -> Start, graft(End)
list_item = ListItem(List=explode.Segments, Index=0, Wrap=True)  # -> Item, Item1, Item2
list_item_2 = ListItem(List=explode.Vertices, Index=0, Wrap=True)  # -> Item, Item1, Item2
line = Line(StartPoint=list_item_2.Item1, EndPoint=end_points.End)
line_2 = Line(StartPoint=list_item_2.Item, EndPoint=end_points.End)
line_3 = Line(StartPoint=list_item_2.Item2, EndPoint=end_points.End)

day_time = Slider(0.667, range=0..1)
julian_day = Slider(74, range=0..100)
longitude = Slider(61, range=0..180)
arch_scale = Slider(45, range=0..100)
sun_scale = Slider(1.06, range=0..10)
latitude = Slider(0, range=0..90)
upper_degree = Slider(75, range=0..75)
lower_degree = Slider(5, range=0..45)

bounding_box = BoundingBox(Content=flatten(explode.Segments), Plane=PlaneXY(0, 0, 0), UnionBox=True)  # -> Box, Box_2
solar_arc = SolarArc(
    JulianDay=julian_day,
    Latitude=latitude,
    Longitude=longitude,
    North=Vector(0, 1, 0),
    Origin=Point(0, 0, 0),
    ScaleArc=arch_scale,
    ScaleSun=sun_scale,
    Offset=day_time)  # -> SolarArc, Sun, SolarVector, TimeOfDay
volume = Volume(Geometry=solar_arc.Sun)  # -> Volume, Centroid
area_2 = Area(Geometry=bounding_box.Box)  # -> Area, Centroid
evaluate_surface = EvaluateSurface(Surface=reparameterize(bounding_box.Box), Point=volume.Centroid)  # -> Point, Normal, UDirection, VDirection, Frame
line_4 = Line(StartPoint=explode.Vertices, EndPoint=graft(area.Centroid))
closest_point = ClosestPoint(Point=area.Centroid, Cloud=evaluate_surface.Point)  # -> ClosestPoint, CPIndex, Distance
line_5 = Line(StartPoint=area_2.Centroid, EndPoint=volume.Centroid)
bounds = Bounds(Numbers=flatten(closest_point.Distance))
construct_domain = ConstructDomain(DomainStart=lower_degree, DomainEnd=upper_degree)

# ----
# Step2_for_modular_surface
shape_piece_2 = Curve([list_item.Item1, line, line_3])
shape_piece_1 = Curve([list_item.Item, line_2, line])
shape_piece_3 = Curve([line_2, line_3, list_item.Item2])
join_curves = JoinCurves(Curves=shape_piece_2, Preserve=False)
join_curves_2 = JoinCurves(Curves=shape_piece_1, Preserve=False)
join_curves_3 = JoinCurves(Curves=shape_piece_3, Preserve=False)
number = Number(radius_of_modular)
fillet = Fillet(Curve=join_curves_2, Radius=number)
fillet_2 = Fillet(Curve=join_curves, Radius=number)
fillet_3 = Fillet(Curve=join_curves_3, Radius=number)
boundary_surfaces = BoundarySurfaces(Edges=fillet_2)
boundary_surfaces_2 = BoundarySurfaces(Edges=fillet_3)
boundary_surfaces_3 = BoundarySurfaces(Edges=fillet)

remap_numbers = RemapNumbers(Value=closest_point.Distance, Source=bounds, Target=construct_domain)  # -> Mapped, graft(Clipped)
curve = Curve([line_4, list_item.Item, list_item.Item1, list_item.Item2])

# ----
# Step3_for_modular_rotate
rotate = Rotate(Geometry=boundary_surfaces_3, Angle=degrees(remap_numbers.Clipped), Plane=list_item.Item)  # -> Geometry, Transform
rotate_2 = Rotate(Geometry=boundary_surfaces, Angle=degrees(remap_numbers.Clipped), Plane=list_item.Item1)  # -> Geometry, Transform
rotate_3 = Rotate(Geometry=boundary_surfaces_2, Angle=degrees(remap_numbers.Clipped), Plane=list_item.Item2)  # -> Geometry, Transform

merge = Merge(Data1=rotate.Geometry, Data2=rotate_2.Geometry, Data3=rotate_3.Geometry)
data = Data(graft(remap_numbers.Clipped))
integer = Integer(lower_degree)
integer_2 = Integer(upper_degree)
gradient = Gradient(
    LowerLimit=integer,
    UpperLimit=integer_2,
    Parameter=data,
    stops=[0: RGB(234, 38, 0), 0.25: RGB(234, 126, 0), 0.5: RGB(254, 244, 84), 0.75: RGB(173, 203, 249), 1: RGB(75, 107, 169)])
pipe = Pipe(Curve=curve, Radius=pipe_radius, Caps="2")
custom_preview = CustomPreview(Geometry=pipe, Material=ColourSwatch(SwatchColor=RGB(236, 241, 255)))
custom_preview_2 = CustomPreview(Geometry=[rotate.Geometry, rotate_2.Geometry, rotate_3.Geometry], Material=gradient)
