# Grasshopper definition Graden_by_bay_grasshopper.gh (Grasshopper 1.0.7)

xy_plane = XYPlane(Origin=Point(0, 0, 0))
series = Series(Start=0, Step=Slider(1, range=0..10), Count=Slider(30, range=0..100))
graph_mapper = GraphMapper(
    reverse(series),
    x0=0,
    x1=30,
    y0=0,
    y1=30,
    container_name="Sine",
    Equation_px=[0, 0.793659389],
    Equation_py=[0.3760731816, 0.08541405201])
unit_z = UnitZ(Factor=series)
sort_list = SortList(Keys=graph_mapper, ValuesA=unit_z)  # -> Keys, ValuesA
circle = Circle(Plane=xy_plane, Radius=sort_list.Keys)
move = Move(Geometry=circle, Motion=sort_list.ValuesA)  # -> Geometry, Transform
list_item = ListItem(List=move.Geometry, Index=Slider(29, range=0..30), Wrap=True)
list_item_2 = ListItem(List=move.Geometry, Index=Slider(8, range=0..30), Wrap=True)
list_item_3 = ListItem(List=move.Geometry, Index=Slider(11, range=0..30), Wrap=True)

number_slider = Slider(20, range=0..100)
number_slider_2 = Slider(20, range=0..100)
divide_curve = DivideCurve(Curve=list_item_2, Count=number_slider, Kinks=False)  # -> Points, Tangents, Parameters
divide_curve_2 = DivideCurve(Curve=list_item_2, Count=number_slider_2, Kinks=False)  # -> Points, Tangents, Parameters
divide_curve_3 = DivideCurve(Curve=list_item_3, Count=number_slider, Kinks=False)  # -> Points, Tangents, Parameters
divide_curve_4 = DivideCurve(Curve=list_item_3, Count=number_slider_2, Kinks=False)  # -> Points, Tangents, Parameters
divide_curve_5 = DivideCurve(Curve=list_item, Count=number_slider, Kinks=False)  # -> Points, Tangents, Parameters
divide_curve_6 = DivideCurve(Curve=list_item, Count=number_slider_2, Kinks=False)  # -> Points, Tangents, Parameters
shift_list = ShiftList(List=divide_curve.Points, Shift=Slider(4, range=0..10), Wrap=True)
shift_list_2 = ShiftList(List=divide_curve_2.Points, Shift=Slider(4, range=0..10), Wrap=True)
shift_list_3 = ShiftList(List=divide_curve_3.Points, Shift=Slider(4, range=0..10), Wrap=True)
shift_list_4 = ShiftList(List=divide_curve_4.Points, Shift=Slider(4, range=0..10), Wrap=True)
shift_list_5 = ShiftList(List=divide_curve_5.Points, Shift=Slider(4, range=0..10), Wrap=True)
shift_list_6 = ShiftList(List=divide_curve_6.Points, Shift=Slider(2, range=0..10), Wrap=True)
merge = Merge(Data1=shift_list_5, Data2=shift_list_3, Data3=shift_list)
merge_2 = Merge(Data1=shift_list_6, Data2=shift_list_4, Data3=shift_list_2)
partition_list = PartitionList(List=merge_2, Size=number_slider_2)
partition_list_2 = PartitionList(List=merge, Size=number_slider)
flip_matrix = FlipMatrix(Data=partition_list_2)
flip_matrix_2 = FlipMatrix(Data=partition_list)
interpolate_t = InterpolateT(Vertices=flip_matrix, TangentStart=Vector(0, 0, 0), TangentEnd=Vector(0, 0, 0), KnotStyle=1)  # -> Curve, Length, Domain
interpolate_t_2 = InterpolateT(Vertices=flip_matrix_2, TangentStart=Vector(0, 0, 0), TangentEnd=Vector(0, 0, 0), KnotStyle=1)  # -> Curve, Length, Domain
panel = Panel(partition_list_2)
curve = Curve([list_item_2, list_item_3, list_item])
merge_3 = Merge(Data1=interpolate_t.Curve, Data2=interpolate_t_2.Curve, Data3=curve)
pipe = Pipe(Curve=merge_3, Radius=Slider(0.17, range=0..0.5), Caps=0)
