# Grasshopper definition SOM_tower.gh (Grasshopper 1.0.7)

number_slider = Slider(30, range=0..100)
number_slider_2 = Slider(53, range=0..100)
rectangle = Rectangle(Plane=PlaneXY(0, 0, 0), XSize=number_slider, YSize=number_slider, Radius=0)  # -> Rectangle, Length
pi = Pi(Factor=1)
series = Series(Start="0", Step=Slider(4.6, range=0..10), Count=number_slider_2)
multiplication = Multiplication(A=pi, B=Slider(0.25, range=0..1))
unit_z = UnitZ(Factor=series)
move = Move(Geometry=rectangle.Rectangle, Motion=unit_z)  # -> Geometry, Transform
series_2 = Series(Start="0", Step=multiplication, Count=number_slider_2)
area = Area(Geometry=move.Geometry)  # -> Area, Centroid
graph_mapper = GraphMapper(
    series_2,
    x0=0,
    x1=20,
    y0=0,
    y1=1,
    container_name="Sine",
    Equation_px=[0, 0.368242681],
    Equation_py=[0.6738176346, 0.9946557283])
scale = Scale(Geometry=move.Geometry, Center=area.Centroid, Factor=graph_mapper)  # -> Geometry, Transform
pi_2 = Pi(Factor=1)
deconstruct_brep = DeconstructBrep(Brep=scale.Geometry)  # -> Faces, Edges, Vertices
multiplication_2 = Multiplication(A=pi_2, B=Slider(0.25, range=0..1))
point = Point(deconstruct_brep.Vertices)
list_item = ListItem(List=point, Index=0, Wrap=True)  # -> Item, Item1, Item2, Item3
series_3 = Series(Start=0, Step=multiplication_2, Count=number_slider_2)
point_2 = Point(list_item.Item3)
point_3 = Point(list_item.Item1)
point_4 = Point(list_item.Item2)
point_5 = Point(list_item.Item)
graph_mapper_2 = GraphMapper(
    series_3,
    x0=0,
    x1=20,
    y0=-14,
    y1=0,
    container_name="Sine",
    Equation_px=[0.00855288282, 0.5612668991],
    Equation_py=[0.9993182421, 0.3095174432])
unit_y = UnitY(Factor=graph_mapper_2)  # -> graft(UnitVector)
negative = Negative(Value=unit_y)
unit_x = UnitX(Factor=graph_mapper_2)  # -> graft(UnitVector)
unit_y_2 = UnitY(Factor=graph_mapper_2)  # -> graft(UnitVector)
move_2 = Move(Geometry=point_5, Motion=negative)  # -> Geometry, Transform
move_3 = Move(Geometry=point_2, Motion=unit_y)  # -> Geometry, Transform
unit_x_2 = UnitX(Factor=graph_mapper_2)  # -> graft(UnitVector)
negative_2 = Negative(Value=unit_x)
negative_3 = Negative(Value=unit_y_2)
move_4 = Move(Geometry=point_3, Motion=unit_x)  # -> Geometry, Transform
move_5 = Move(Geometry=point_5, Motion=negative_2)  # -> Geometry, Transform
negative_4 = Negative(Value=unit_x_2)
move_6 = Move(Geometry=point_3, Motion=negative_3)  # -> Geometry, Transform
move_7 = Move(Geometry=point_4, Motion=unit_y_2)  # -> Geometry, Transform
move_8 = Move(Geometry=point_4, Motion=unit_x_2)  # -> Geometry, Transform
move_9 = Move(Geometry=point_2, Motion=negative_4)  # -> Geometry, Transform
interpolate = Interpolate(Vertices=flatten(move_2.Geometry), Degree=3, Periodic=False, KnotStyle=1)  # -> Curve, Length, Domain
interpolate_2 = Interpolate(Vertices=flatten(move_3.Geometry), Degree=3, Periodic=False, KnotStyle=1)  # -> Curve, Length, Domain
interpolate_3 = Interpolate(Vertices=flatten(move_5.Geometry), Degree=3, Periodic=False, KnotStyle=1)  # -> Curve, Length, Domain
interpolate_4 = Interpolate(Vertices=flatten(move_4.Geometry), Degree=3, Periodic=False, KnotStyle=1)  # -> Curve, Length, Domain
interpolate_5 = Interpolate(Vertices=flatten(move_6.Geometry), Degree=3, Periodic=False, KnotStyle=1)  # -> Curve, Length, Domain
interpolate_6 = Interpolate(Vertices=flatten(move_7.Geometry), Degree=3, Periodic=False, KnotStyle=1)  # -> Curve, Length, Domain
interpolate_7 = Interpolate(Vertices=flatten(move_8.Geometry), Degree=3, Periodic=False, KnotStyle=1)  # -> Curve, Length, Domain
interpolate_8 = Interpolate(Vertices=flatten(move_9.Geometry), Degree=3, Periodic=False, KnotStyle=1)  # -> Curve, Length, Domain
polyline = PolyLine(
    Vertices=[move_5.Geometry, move_4.Geometry, move_6.Geometry, move_7.Geometry, move_8.Geometry, move_9.Geometry, move_3.Geometry, move_2.Geometry],
    Closed=True)
_4point_surface = _4PointSurface()
loft = Loft(
    Curves=[interpolate_3.Curve, interpolate.Curve],
    Options={Adjust=False, Closed=False, LoftEnds=0, LoftSimp=0, LoftType=0, Rebuild=10, Refit=0.01})
loft_2 = Loft(
    Curves=[interpolate_2.Curve, interpolate.Curve],
    Options={Adjust=False, Closed=False, LoftEnds=0, LoftSimp=0, LoftType=0, Rebuild=10, Refit=0.01})
loft_3 = Loft(
    Curves=[interpolate_3.Curve, interpolate_4.Curve],
    Options={Adjust=False, Closed=False, LoftEnds=0, LoftSimp=0, LoftType=0, Rebuild=10, Refit=0.01})
list_item_2 = ListItem(List=flatten(polyline), Index="-1", Wrap=True)
loft_4 = Loft(
    Curves=[interpolate_5.Curve, interpolate_6.Curve],
    Options={Adjust=False, Closed=False, LoftEnds=0, LoftSimp=0, LoftType=0, Rebuild=10, Refit=0.01})
list_item_3 = ListItem(List=flatten(polyline), Index="0", Wrap=True)
loft_5 = Loft(
    Curves=[interpolate_8.Curve, interpolate_7.Curve],
    Options={Adjust=False, Closed=False, LoftEnds=0, LoftSimp=0, LoftType=0, Rebuild=10, Refit=0.01})
boundary_surfaces = BoundarySurfaces(Edges=polyline)
curve = Curve(list_item_3)
curve_2 = Curve(list_item_2)
brep_join = BrepJoin(Breps=[curve_2, curve, loft_2, loft, loft_3, loft_4, loft_5])  # -> Breps, Closed
