# Grasshopper definition Truss_metal.gh (Grasshopper 1.0.7)
# plug-ins: ShapeDiver

y_direction_length = Slider(50, range=50..100)

# ----
# This is my truss parameter!
with_lower_truss = Slider(1, range=0..1)
x_direction_length = Slider(50, range=50..100)
h_b = Slider(4, range=0..10)
with_upper_truss = Slider(1, range=0..1)
y_truss_number = Slider(6, range=0..10)
radius = Slider(0.27, range=0.02..0.6)
x_truss_number = Slider(5, range=0..10)
h_a = Slider(7, range=0..10)

construct_point = ConstructPoint(XCoordinate=x_direction_length, YCoordinate="0", ZCoordinate="0")
construct_point_2 = ConstructPoint(XCoordinate="0", YCoordinate="0", ZCoordinate="0")
line = Line(StartPoint=construct_point_2, EndPoint=construct_point)

cluster = Cluster(curve=line, integer_2=x_truss_number, integer=h_b)  # -> point_3, line_2, line_4, result, geometry
cluster_2 = Cluster_2(geometry=line, factor=y_direction_length, count=cluster.result, integer=h_a)  # -> point_4, line_3, line_4, geometry_2
merge = Merge(Data1=cluster.line_2, Data2=cluster.line_4, Data3=cluster_2.line_3, Data4=cluster_2.line_4)
cluster_3 = Cluster_3(
    start_point=cluster.geometry,
    end_point=cluster_2.geometry_2,
    integer=y_truss_number,
    start_point_2=cluster.point_3,
    end_point_2=cluster_2.point_4,
    start_point_3=cluster.point_3,
    end_point_3=cluster_2.point_4)  # -> line_11, top_line_2, line_9, integer_3, bottom_line_1_2, line_12, line_8, bottom_line_2_2, line_10
cluster_4 = Cluster_4(
    curve_2=cluster_3.top_line_2,
    A=cluster_3.integer_3,
    integer_2=with_upper_truss,
    curve=cluster_3.line_8,
    A_2=cluster_3.integer_3,
    integer=with_lower_truss)  # -> curve_4, curve_3
line_xaxis = Curve([cluster_4.curve_4, cluster_4.curve_3])
diagnal_xaxis = Curve(merge)
vertical_yaxis = Curve([cluster_3.line_9, cluster_3.line_10])
diagnal_yaxis = Curve([cluster_3.line_11, cluster_3.line_12])
line_yaxis = Curve([cluster_3.top_line_2, cluster_3.bottom_line_1_2, cluster_3.bottom_line_2_2])
merge_2 = Merge(Data1=line_yaxis, Data2=diagnal_xaxis, Data3=diagnal_yaxis, Data4=vertical_yaxis, Data5=line_xaxis)
curve = Curve(merge_2)
panel = Panel("https://static.vecteezy.com/system/resources/previews/001/948/691/non_2x/metal-texture-background-illustration-vector.jpg")
pipe = Pipe(Curve=curve, Radius=radius, Caps=0)
shapediverextractmeshuvs = ShapeDiverExtractMeshUVs()
shapedivermaterial = ShapeDiverMaterial(Color=ColourSwatch(SwatchColor=RGB(84, 172, 179)), Texture=panel, FlatShading=False)
shapediverdisplaygeometry = ShapeDiverDisplayGeometry(Geometry=pipe, ShapeDiverMaterial=shapedivermaterial)

# ==== cluster Cluster
curve = ClusterInput()
integer = ClusterInput()
integer_2 = ClusterInput()
integer_3 = Integer(integer_2)
multiplication = Multiplication(A=integer_3, B="2")
result = ClusterOutput(multiplication)
divide_curve = DivideCurve(Curve=curve, Count=multiplication, Kinks=False)  # -> Points, Tangents, Parameters
dispatch = Dispatch(List=divide_curve.Points, DispatchPattern=[True, False])  # -> ListA, ListB
integer_4 = Integer(integer)
unit_z = UnitZ(Factor=integer_4)
point = Point(dispatch.ListB)
point_2 = Point(dispatch.ListA)
point_3 = ClusterOutput(point_2)
point_4 = Point(dispatch.ListA)
move = Move(Geometry=point, Motion=unit_z)  # -> Geometry, Transform
geometry = ClusterOutput(move.Geometry)
shift_list = ShiftList(List=point_4, Shift="-1", Wrap="0")
shift_list_2 = ShiftList(List=point_2, Shift="1", Wrap="0")
line = Line(StartPoint=shift_list_2, EndPoint=move.Geometry)
line_2 = ClusterOutput(line)
line_3 = Line(StartPoint=shift_list, EndPoint=move.Geometry)
line_4 = ClusterOutput(line_3)

# ==== cluster Cluster_2
count = ClusterInput()
factor = ClusterInput()
geometry = ClusterInput()
integer = ClusterInput()

unit_y = UnitY(Factor=factor)
move = Move(Geometry=geometry, Motion=unit_y)  # -> Geometry, Transform
divide_curve = DivideCurve(Curve=move.Geometry, Count=count, Kinks=False)  # -> Points, Tangents, Parameters
dispatch = Dispatch(List=divide_curve.Points, DispatchPattern=[True, False])  # -> ListA, ListB
integer_2 = Integer(integer)
unit_z = UnitZ(Factor=integer_2)
point = Point(dispatch.ListB)
point_2 = Point(dispatch.ListA)
move_2 = Move(Geometry=point, Motion=unit_z)  # -> Geometry, Transform
point_3 = Point(dispatch.ListA)
shift_list = ShiftList(List=point_2, Shift="1", Wrap="0")
shift_list_2 = ShiftList(List=point_3, Shift="-1", Wrap="0")
line = Line(StartPoint=shift_list_2, EndPoint=move_2.Geometry)
line_2 = Line(StartPoint=shift_list, EndPoint=move_2.Geometry)

point_4 = ClusterOutput(point_2)
geometry_2 = ClusterOutput(move_2.Geometry)
line_3 = ClusterOutput(line_2)
line_4 = ClusterOutput(line)

# ==== cluster Cluster_3
start_point = ClusterInput()
end_point = ClusterInput()
start_point_2 = ClusterInput()
end_point_2 = ClusterInput()
start_point_3 = ClusterInput()
end_point_3 = ClusterInput()
integer = ClusterInput()

line = Line(StartPoint=start_point_2, EndPoint=end_point_2)
line_2 = Line(StartPoint=start_point_3, EndPoint=end_point_3)
line_3 = Line(StartPoint=start_point, EndPoint=end_point)
shift_list = ShiftList(List=line_2, Shift="1", Wrap="0")
shift_list_2 = ShiftList(List=line, Shift="-1", Wrap="0")
bottom_line_1 = Curve(shift_list_2)
bottom_line_2 = Curve(shift_list)
top_line = Curve(line_3)
integer_2 = Integer(integer)
divide_curve = DivideCurve(Curve=top_line, Count=integer_2, Kinks=False)  # -> Points, Tangents, Parameters
divide_curve_2 = DivideCurve(Curve=top_line, Count=integer_2, Kinks=False)  # -> Points, Tangents, Parameters
divide_curve_3 = DivideCurve(Curve=bottom_line_1, Count=integer_2, Kinks=False)  # -> Points, Tangents, Parameters
divide_curve_4 = DivideCurve(Curve=bottom_line_2, Count=integer_2, Kinks=False)  # -> Points, Tangents, Parameters
shift_list_3 = ShiftList(List=divide_curve.Points, Shift="1", Wrap="0")
line_4 = Line(StartPoint=divide_curve_2.Points, EndPoint=divide_curve_4.Points)
shift_list_4 = ShiftList(List=divide_curve_2.Points, Shift="1", Wrap="0")
line_5 = Line(StartPoint=divide_curve.Points, EndPoint=divide_curve_3.Points)
line_6 = Line(StartPoint=shift_list_4, EndPoint=divide_curve_4.Points)
line_7 = Line(StartPoint=shift_list_3, EndPoint=divide_curve_3.Points)

line_8 = ClusterOutput(line_2)
top_line_2 = ClusterOutput(top_line)
bottom_line_1_2 = ClusterOutput(bottom_line_1)
bottom_line_2_2 = ClusterOutput(bottom_line_2)
line_9 = ClusterOutput(line_5)
line_10 = ClusterOutput(line_4)
line_11 = ClusterOutput(line_7)
line_12 = ClusterOutput(line_6)
integer_3 = ClusterOutput(integer_2)

# ==== cluster Cluster_4
curve = ClusterInput()
curve_2 = ClusterInput()
A = ClusterInput()
A_2 = ClusterInput()
integer = ClusterInput()
integer_2 = ClusterInput()

integer_3 = Integer(integer_2)
integer_4 = Integer(integer)
multiplication = Multiplication(A=A_2, B=integer_4)
multiplication_2 = Multiplication(A=A, B=integer_3)
divide_curve = DivideCurve(Curve=curve, Count=multiplication, Kinks=False)  # -> Points, Tangents, Parameters
divide_curve_2 = DivideCurve(Curve=curve_2, Count=multiplication_2, Kinks=False)  # -> Points, Tangents, Parameters
flip_matrix = FlipMatrix(Data=divide_curve_2.Points)
flip_matrix_2 = FlipMatrix(Data=divide_curve.Points)
interpolate = Interpolate(Vertices=flip_matrix, Degree=3, Periodic=False, KnotStyle=1)  # -> Curve, Length, Domain
interpolate_2 = Interpolate(Vertices=flip_matrix_2, Degree=3, Periodic=False, KnotStyle=1)  # -> Curve, Length, Domain

curve_3 = ClusterOutput(interpolate_2.Curve)
curve_4 = ClusterOutput(interpolate.Curve)
