# Grasshopper definition catenary_dome.gh (Grasshopper 1.0.7)

number_slider = Slider(360, range=0..1000)
number_slider_2 = Slider(180, range=0..1000)
subtraction = Subtraction(A=number_slider, B=number_slider_2)
construct_domain = ConstructDomain(DomainStart=number_slider, DomainEnd=subtraction)
number_slider_3 = Slider(100, range=0..100)
construct_domain_2 = ConstructDomain(DomainStart=Slider(0, range=0..1000), DomainEnd=number_slider_2)
xy_plane = XYPlane(Origin=Point(0, 0, 0))
radians = Radians(Degrees=construct_domain)
radians_2 = Radians(Degrees=construct_domain_2)
division = Division(A=number_slider_3, B=Slider(2, range=0..10))
number_slider_4 = Slider(30, range=0..100)
arc = Arc(Plane=xy_plane, Radius=division, Angle=radians)  # -> Arc, Length
arc_2 = Arc(Plane=xy_plane, Radius=number_slider_3, Angle=radians_2)  # -> Arc, Length
divide_curve = DivideCurve(Curve=arc_2.Arc, Count=number_slider_4, Kinks=False)  # -> Points, Tangents, Parameters
divide_curve_2 = DivideCurve(Curve=arc.Arc, Count=number_slider_4, Kinks=False)  # -> reverse(Points), Tangents, Parameters

line = Line(StartPoint=divide_curve.Points, EndPoint=divide_curve_2.Points)
length = Length(Curve=line)
construct_domain_3 = ConstructDomain(DomainStart=Slider(1.8, range=0..10), DomainEnd=Slider(2.1, range=0..10))
unit_z = UnitZ(Factor=1)
range = Range(Domain=construct_domain_3, Steps=number_slider_4)
multiplication = Multiplication(A=length, B=range)
catenary = Catenary(PointA=divide_curve.Points, PointB=divide_curve_2.Points, Length=multiplication, Gravity=unit_z)
number_slider_5 = Slider(2, range=0..10)
pipe = Pipe(Curve=catenary, Radius=Slider(0.3, range=0..1), Caps=number_slider_5)
pipe_2 = Pipe(Curve=[arc_2.Arc, arc.Arc], Radius=Slider(0.8, range=0..1), Caps=number_slider_5)
merge = Merge(Data1=pipe_2, Data2=pipe)
