# Grasshopper definition dome.gh (Grasshopper 1.0.7)
# plug-ins: LunchBox

xz_plane = XZPlane(Origin=Point(0, 0, 0))
multiplication = Multiplication(A=Slider(30, range=0..30))
multiplication_2 = Multiplication(A=Slider(23, range=0..30))
multiplication_3 = Multiplication(A=Slider(14, range=0..30))
arc = Arc(Plane=xz_plane, Radius=multiplication, Angle=Domain(0, 3.141592654))  # -> Arc, Length
unit_y = UnitY(Factor=multiplication_2)
unit_x = UnitX(Factor=multiplication_3)
end_points = EndPoints(Curve=arc.Arc)  # -> Start, End
negative = Negative(Value=unit_x)
move = Move(Geometry=end_points.Start, Motion=unit_y)  # -> Geometry, Transform
move_2 = Move(Geometry=move.Geometry, Motion=negative)  # -> Geometry, Transform
mirror = Mirror(Geometry=move_2.Geometry, Plane=xz_plane)  # -> Geometry, Transform
arc_3pt = Arc3Pt(PointA=move.Geometry, PointB=end_points.Start, PointC=mirror.Geometry)  # -> Arc, Plane, Radius
sweep1 = Sweep1(Rail=arc.Arc, Sections=arc_3pt.Arc, Miter=1)

number_slider = Slider(24, range=0..100)
division = Division(A=number_slider, B=Slider(3, range=0..10))
brep_edges = BrepEdges(Brep=sweep1)  # -> Naked, Interior, NonManifold
hexagonal_structure = HexagonalStructure(Surface=sweep1, UDivisions=number_slider, VDivisions=division, AdjustShape=0.3, Type=False)  # -> StructureLines, StructureNodes
number_slider_2 = Slider(50, range=0..100)
pipe = Pipe(Curve=brep_edges.Naked, Radius=Slider(0.6, range=0..10), Caps=2)
pipe_2 = Pipe(Curve=hexagonal_structure.StructureLines, Radius=Slider(0.4, range=0..10), Caps=2)
brep_join = BrepJoin(Breps=[pipe_2, pipe])  # -> Breps, Closed
custom_preview = CustomPreview(Geometry=brep_join.Breps, Material=ColourSwatch(SwatchColor=RGB(158, 233, 255)))
