# Grasshopper definition kinetic_facade.gh (Grasshopper 1.0.7)

xz_plane = XZPlane(Origin=Point(0, 0, 0))
triangular = Triangular(Plane=xz_plane, Size=Slider(3, range=0..10), ExtentX=Slider(7, range=0..10), ExtentY=Slider(7, range=0..10))  # -> graft(Cells), Points
explode = Explode(Curve=triangular.Cells, Recursive=True)  # -> Segments, Vertices
area = Area(Geometry=triangular.Cells)  # -> Area, Centroid
unit_y = UnitY(Factor=1)
negative = Negative(Value=Slider(1.05, range=0..10))
point_on_curve = PointOnCurve(explode.Segments, parameter=1)
point_on_curve_2 = PointOnCurve(explode.Segments, parameter=0)
line_sdl = LineSDL(Start=area.Centroid, Direction=unit_y, Length=negative)
end_points = EndPoints(Curve=line_sdl)  # -> Start, End
list_item = ListItem(List=point_on_curve, Index=0, Wrap=True)  # -> Item, Item1, Item2
list_item_2 = ListItem(List=point_on_curve_2, Index=0, Wrap=True)  # -> Item, Item1, Item2
line = Line(StartPoint=list_item.Item1, EndPoint=list_item_2.Item1)
line_2 = Line(StartPoint=end_points.End, EndPoint=list_item_2.Item1)
line_3 = Line(StartPoint=end_points.End, EndPoint=list_item.Item1)
join_curves = JoinCurves(Curves=[line_3, line, line_2], Preserve=False)
line_4 = Line(StartPoint=list_item.Item2, EndPoint=list_item_2.Item2)
line_5 = Line(StartPoint=end_points.End, EndPoint=list_item_2.Item2)
line_6 = Line(StartPoint=end_points.End, EndPoint=list_item.Item2)
number_slider = Slider(0.131, range=0..1)
line_7 = Line(StartPoint=end_points.End, EndPoint=list_item_2.Item)
line_8 = Line(StartPoint=list_item.Item, EndPoint=list_item_2.Item)
line_9 = Line(StartPoint=end_points.End, EndPoint=list_item.Item)
join_curves_2 = JoinCurves(Curves=[line_4, line_5, line_6], Preserve=False)
join_curves_3 = JoinCurves(Curves=[line_8, line_7, line_9], Preserve=False)
fillet = Fillet(Curve=join_curves_3, Radius=number_slider)
fillet_2 = Fillet(Curve=join_curves, Radius=number_slider)
fillet_3 = Fillet(Curve=join_curves_2, Radius=number_slider)
curve = Curve(explode.Segments)
negative_2 = Negative(Value=Slider(14.88, range=0..30))
list_item_3 = ListItem(List=curve, Index=0, Wrap=True)  # -> Item, Item1, Item2
negative_3 = Negative(Value=negative_2)
line_10 = Line(list_item_3.Item)
line_11 = Line(list_item_3.Item1)
line_12 = Line(list_item_3.Item2)

area_2 = Area(Geometry=triangular.Cells)  # -> Area, Centroid
bounding_box = BoundingBox(Content=flatten(triangular.Cells), Plane=PlaneXY(0, 0, 0), UnionBox=True)  # -> Box, Box_2
md_slider = MDSlider(
    SliderMode=0,
    slider_value=Point(0.4276251444, 0.4671533008, 0.5),
    x_domain=Domain(0, 20),
    y_domain=Domain(0, 20),
    z_domain=Domain(0, 1))
geometry = Geometry(bounding_box.Box)
evaluate_surface = EvaluateSurface(Surface=geometry, Point=md_slider)  # -> Point, Normal, UDirection, VDirection, Frame
closest_point = ClosestPoint(Point=area.Centroid, Cloud=evaluate_surface.Point)  # -> ClosestPoint, CPIndex, Distance
construct_domain = ConstructDomain(DomainStart=Slider(0.2, range=0..1), DomainEnd=Slider(0.8, range=0..1))
bounds = Bounds(Numbers=flatten(closest_point.Distance))
remap_numbers = RemapNumbers(Value=closest_point.Distance, Source=bounds, Target=construct_domain)  # -> Mapped, Clipped
graph_mapper = GraphMapper(
    remap_numbers.Clipped,
    x0=0,
    x1=1,
    y0=0,
    y1=1,
    container_name="Sine",
    Equation_px=[0, 0.2652172148],
    Equation_py=[0, 0.5559418201])

rotate_axis = RotateAxis(Geometry=fillet, Angle=graph_mapper, Axis=line_10)  # -> Geometry, Transform
rotate_axis_2 = RotateAxis(Geometry=fillet_3, Angle=graph_mapper, Axis=line_12)  # -> Geometry, Transform
rotate_axis_3 = RotateAxis(Geometry=fillet_2, Angle=graph_mapper, Axis=line_11)  # -> Geometry, Transform
boundary_surfaces = BoundarySurfaces(Edges=rotate_axis.Geometry)
boundary_surfaces_2 = BoundarySurfaces(Edges=rotate_axis_2.Geometry)
boundary_surfaces_3 = BoundarySurfaces(Edges=rotate_axis_3.Geometry)
custom_preview = CustomPreview(
    Geometry=[boundary_surfaces, boundary_surfaces_2, boundary_surfaces_3],
    Material={diffuse=RGB(221, 160, 221), emission=RGB(66, 48, 66), shine=0.5, specular=RGB(255, 255, 255), transparency=0})
