# Grasshopper definition kinetic_facade2.gh (Grasshopper 1.0.7)

number_slider = Slider(5, range=0..100)
number_slider_2 = Slider(10, range=0..10)
xz_plane = XZPlane(Origin=Point(0, 0, 0))
rectangular = Rectangular(Plane=xz_plane, SizeX=number_slider, SizeY=number_slider, ExtentX=number_slider_2, ExtentY=number_slider_2)  # -> Cells, Points
area = Area(Geometry=rectangular.Cells)  # -> Area, Centroid
deconstruct_brep = DeconstructBrep(Brep=rectangular.Cells)  # -> Faces, Edges, Vertices
point = Point(deconstruct_brep.Vertices)
scale = Scale(Geometry=rectangular.Cells, Center=area.Centroid, Factor=Slider(0.332, range=0..1))  # -> Geometry, Transform
unit_y = UnitY(Factor=1)
point_2 = Point(area.Centroid)
multiplication = Multiplication(A=Slider(5, range=0..10), B=Slider(0.581, range=0..1))
line_sdl = LineSDL(Start=point_2, Direction=unit_y, Length=multiplication)
move = Move(Geometry=scale.Geometry, Motion=line_sdl)  # -> Geometry, Transform
list_item = ListItem(List=point, Index=0, Wrap=True)  # -> Item, Item1, Item2, Item3
deconstruct_brep_2 = DeconstructBrep(Brep=move.Geometry)  # -> Faces, Edges, Vertices
end_points = EndPoints(Curve=line_sdl)  # -> Start, End
point_3 = Point(list_item.Item2)
point_4 = Point(list_item.Item)
point_5 = Point(list_item.Item3)
point_6 = Point(list_item.Item1)
point_7 = Point(end_points.End)
md_slider = MDSlider(
    SliderMode=0,
    slider_value=Point(0.4722729194, 0.6081576464, 0.5),
    x_domain=Domain(0, 1),
    y_domain=Domain(0, 1),
    z_domain=Domain(0, 1))
brep_join = BrepJoin(Breps=flatten(rectangular.Cells))  # -> Breps, Closed
loft_options = LoftOptions(Closed=False, Adjust=False, Rebuild=0, Refit=0, Type=Slider(5, range=0..10))
loft = Loft(Curves=[deconstruct_brep_2.Faces, deconstruct_brep.Faces], Options=loft_options)
deconstruct_brep_3 = DeconstructBrep(Brep=loft)  # -> Faces, Edges, Vertices
evaluate_surface = EvaluateSurface(Surface=reparameterize(brep_join.Breps), Point=md_slider)  # -> Point, Normal, UDirection, VDirection, Frame
list_item_2 = ListItem(List=deconstruct_brep_3.Faces, Index=0, Wrap=True)  # -> Item, Item1, Item2, Item3
distance = Distance(PointA=evaluate_surface.Point, PointB=graft(area.Centroid))
curve = Curve(deconstruct_brep.Edges)
list_item_3 = ListItem(List=curve, Index=0, Wrap=True)  # -> Item, Item1, Item2, Item3
multiplication_2 = Multiplication(A=distance, B=Slider(0.543, range=0..1))
negative = Negative(Value=multiplication_2)
rotate = Rotate(Geometry=list_item_2.Item, Angle=degrees(negative), Plane=list_item_3.Item2)  # -> Geometry, Transform
rotate_2 = Rotate(Geometry=list_item_2.Item2, Angle=degrees(negative), Plane=list_item_3.Item)  # -> Geometry, Transform
rotate_3 = Rotate(Geometry=list_item_2.Item1, Angle=degrees(negative), Plane=list_item_3.Item3)  # -> Geometry, Transform
rotate_4 = Rotate(Geometry=list_item_2.Item3, Angle=degrees(negative), Plane=list_item_3.Item1)  # -> Geometry, Transform
custom_preview = CustomPreview(
    Geometry=[rotate_3.Geometry, rotate_2.Geometry, rotate.Geometry, rotate_4.Geometry],
    Material={diffuse=RGB(221, 160, 221), emission=RGB(66, 48, 66), shine=0.5, specular=RGB(255, 255, 255), transparency=0})
