# Grasshopper definition roof_facade.gh (Grasshopper 1.0.7)

number_slider = Slider(37, range=0..50)
number_slider_2 = Slider(37, range=0..50)
number_slider_3 = Slider(37, range=0..50)
series = Series(Start=0, Step=Slider(3, range=0..10), Count=number_slider)
series_2 = Series(Start=0, Step=Slider(3, range=0..10), Count=number_slider_2)
series_3 = Series(Start=0, Step=Slider(3, range=0..10), Count=number_slider_3)
series_4 = Series(Start=0, Step=Slider(7, range=0..10), Count=number_slider)
series_5 = Series(Start=0, Step=Slider(7, range=0..10), Count=number_slider_2)
series_6 = Series(Start=0, Step=Slider(7, range=0..10), Count=number_slider_3)
graph_mapper = GraphMapper(series_4, x0=0, x1=6, y0=0, y1=30, container_name="Sine", Equation_px=[0, 0.599506557], Equation_py=[0, 0.9808933139])
graph_mapper_2 = GraphMapper(series_5, x0=0, x1=6, y0=0, y1=30, container_name="Sine", Equation_px=[0, 0.6026885509], Equation_py=[0.3718102574, 1])
graph_mapper_3 = GraphMapper(
    series_6,
    x0=0,
    x1=6,
    y0=0,
    y1=30,
    container_name="Sine",
    Equation_px=[0.3286232352, 0.929623127],
    Equation_py=[0.007536053658, 0.9834346771])
vector_xyz = VectorXYZ(XComponent=series, YComponent=0, ZComponent=graph_mapper)  # -> Vector, Length
vector_xyz_2 = VectorXYZ(XComponent=series_2, YComponent=0, ZComponent=graph_mapper_2)  # -> Vector, Length
vector_xyz_3 = VectorXYZ(XComponent=series_3, YComponent=0, ZComponent=graph_mapper_3)  # -> Vector, Length
unit_y = UnitY(Factor=Slider(100, range=0..100))
unit_y_2 = UnitY(Factor=Slider(50, range=0..100))
point = Point(vector_xyz.Vector)
point_2 = Point(vector_xyz_2.Vector)
point_3 = Point(vector_xyz_3.Vector)
move = Move(Geometry=point_2, Motion=unit_y)  # -> Geometry, Transform
move_2 = Move(Geometry=point_3, Motion=unit_y_2)  # -> Geometry, Transform
interpolate = Interpolate(Vertices=point, Degree=3, Periodic=False, KnotStyle=1)  # -> Curve, Length, Domain
interpolate_2 = Interpolate(Vertices=move_2.Geometry, Degree=3, Periodic=False, KnotStyle=1)  # -> Curve, Length, Domain
interpolate_3 = Interpolate(Vertices=move.Geometry, Degree=3, Periodic=False, KnotStyle=1)  # -> Curve, Length, Domain

number_slider_4 = Slider(20, range=0..100)
loft = Loft(
    Curves=[interpolate.Curve, interpolate_2.Curve, interpolate_3.Curve],
    Options={Adjust=False, Closed=False, LoftEnds=0, LoftSimp=0, LoftType=0, Rebuild=10, Refit=0.01})
divide_domain² = DivideDomain²(Domain=loft, UCount=number_slider_4, VCount=number_slider_4)
md_slider = MDSlider(SliderMode=0, slider_value=Point(0.5, 0.5, 0.5), x_domain=Domain(0, 1), y_domain=Domain(0, 1), z_domain=Domain(0, 1))
isotrim = Isotrim(Surface=loft, Domain=divide_domain²)
evaluate_surface = EvaluateSurface(Surface=reparameterize(isotrim), Point=md_slider)  # -> Point, Normal, UDirection, VDirection, Frame
negative = Negative(Value=Slider(6, range=0..10))
circle = Circle(Plane=evaluate_surface.Point, Radius=Slider(1.299, range=0..10))
area = Area(Geometry=circle)  # -> Area, Centroid
line_sdl = LineSDL(Start=area.Centroid, Direction=evaluate_surface.Normal, Length=negative)
deconstruct_brep = DeconstructBrep(Brep=isotrim)  # -> Faces, Edges, Vertices
scale = Scale(Geometry=circle, Center=area.Centroid, Factor=Slider(0.836, range=0..1))  # -> Geometry, Transform
move_3 = Move(Geometry=scale.Geometry, Motion=line_sdl)  # -> Geometry, Transform
area_2 = Area(Geometry=move_3.Geometry)  # -> Area, Centroid
surface = Surface(deconstruct_brep.Faces)
rotate = Rotate(Geometry=move_3.Geometry, Angle=degrees(Slider(10, range=0..180)), Plane=area_2.Centroid)  # -> graft(Geometry), Transform
merge = Merge(Data1=rotate.Geometry, Data2=surface)
loft_2 = Loft(Curves=merge, Options={Adjust=False, Closed=False, LoftEnds=0, LoftSimp=0, LoftType=0, Rebuild=10, Refit=0.01})
